# Grasshopper definition PLAN_PROCESS.gh (Grasshopper 0.9.76)
# plug-ins: DataColorSimilarity, ImageClass

path = FilePath(["E:\Dropbox (MIT)\courses\mechatronic optics\class files\class 2\PLAN_SAMPLES\00001.jpg", "E:\Dropbox (MIT)\courses\mechatronic optics\class files\class 2\PLAN_SAMPLES\00007.jpg", "E:\Dropbox (MIT)\courses\mechatronic optics\class files\class 2\PLAN_SAMPLES\00021.jpg", "E:\Dropbox (MIT)\courses\mechatronic optics\class files\class 2\PLAN_SAMPLES\22-06.jpg", "E:\Dropbox (MIT)\courses\mechatronic optics\class files\class 2\PLAN_SAMPLES\00039.jpg", "E:\Dropbox (MIT)\courses\mechatronic optics\class files\class 2\PLAN_SAMPLES\00050.jpg", "E:\Dropbox (MIT)\courses\mechatronic optics\class files\class 2\PLAN_SAMPLES\1303267693-plan-01.jpg", "E:\Dropbox (MIT)\courses\mechatronic optics\class files\class 2\PLAN_SAMPLES\floor2.jpg", "E:\Dropbox (MIT)\courses\mechatronic optics\class files\class 2\PLAN_SAMPLES\Ground_MPLUSM_ARCHITECTS_ANEMOLIA_VILLA_SANTORINI_-GROUND_FLOOR_PLAN.jpg", "E:\Dropbox (MIT)\courses\mechatronic optics\class files\class 2\PLAN_SAMPLES\LymanFloorPlan.jpg"])
number_slider = Slider(0.123, range=0..1)  # disabled
number_slider_2 = Slider(1, range=0..1)  # disabled
number_slider_3 = Slider(0, range=0..77)  # disabled
item = ListItem(List=path, Index=Slider(2, range=0..10), Wrap=True)
imload = ImageLoad(Path=item)  # -> Image, W, H, PreviewGUID
imageerosion = ImageErosion(
    Image=imload.Image,
    Threshold=Slider(10, range=0..1000),
    Iterations=Slider(15, range=0..20),
    NoiseRemovalO=number_slider,
    CumulativeO=number_slider_3,
    ContourChainO=number_slider_2)  # -> Crvs, ContainmentBranch, ContainmentItem, Image

# ----
# ROOM STATS
lng = ListLength(List=imageerosion.Crvs)
area = Area(Geometry=imageerosion.Crvs)  # -> Area, Centroid
dom = ConstructDomain(DomainStart=Slider(5, range=0..10), DomainEnd=lng)
subset = SubList(List=area.Area, Domain=dom, Wrap=False)  # -> List, Index
datahistogram = DataHistogram(Values=subset.List, NumberOfBins=Slider(81, range=0..100))  # -> BinnedValues, BinValues

# ----
# DISPLAY ROOMS
sqgrid = Square(Plane=PlaneXY(0, 0, 0), Size=Slider(764, range=0..2000), ExtentX=5, ExtentY=5)  # -> Cells, flatten(Points)
subtraction = Subtraction(A=sqgrid.Points, B=area.Centroid)
move = Move(Geometry=imageerosion.Crvs, Motion=subtraction)  # -> Geometry, Transform

graph = QuickGraph(datahistogram.BinnedValues)
